# Grasshopper definition Example.gh (Grasshopper 1.0.7)
# plug-ins: Tile.Core.Grashopper, Bifocals

# ---- group: Bugs
crv = Curve(<curve referenced from the Rhino model>)
boundary = BoundarySurfaces(Edges=crv)
item = ListItem(List=boundary, Index=Slider(1, range=0..1), Wrap=True)
popgeo = PopulateGeometry(Geometry=item, Count=100, Seed=1)
concavehull = ConcaveHullFromPoints(Points=popgeo, Alpha=Slider(1.9, range=0..10))  # -> ConcaveMesh, OuterPoints, Profile, Indice
crv_2 = Curve(concavehull.Profile)

# ----
list = ValueList({"All": 0, "H": 1, "H1": 2, "T": 3, "P": 4, "F": 5}, selected="All")

list_2 = ValueList({"H": 0, "T": 1, "P": 2, "F": 3}, selected="H")
list_3 = ValueList({"MetaTiles": 0, "Hat": 1, "H": 2, "H1": 3, "T": 4, "P": 5, "F": 6, "All": 7}, selected="MetaTiles")
sp = Shape()
list_4 = ValueList({"All": 0, "H": 1, "H1": 2, "T": 3, "P": 4, "F": 5}, selected="All")
pattern = PatternSetting(Label=list_4, Scale=1, Frame=Toggle(False), Shape=sp, ColourFromObject=Toggle(False))  # -> Preview, PatternSetting
eincore = EinsteinCore(Reset=Button(), Execute=Button(), InitialType=list_2, Display=list_3)  # -> Geom, Level, Data, EinsteinData
einpatch = EinsteinPatternPatch(
    Einstein=eincore.EinsteinData,
    OriginPoint=Point(0, 0, 0),
    SetBlock=Button(),
    PlaceBlock=Button(),
    Scale=1,
    Patterns=pattern.PatternSetting)

# ---- group: BUGS
crv_3 = Curve([<curve referenced from the Rhino model> x2])
convexhull = ConvexHullFromCurves(Curves=crv_3, Tolerance=3)  # -> OuterPoints, Profile

# ----
pattern_2 = PatternSetting(Label=list, Scale=1, Frame=False, ColourFromObject=False)  # -> Preview, PatternSetting
crvs = Curves(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)
crvs_2 = Curves([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])
pt = Point(Point(19.19162697, 3.894252012, 0))
# The input can be either single or multiple curve.
# "Pre" will provide a vision for the configure of Hat tiles.
# Usually, it the level larger than 5, it would take much longer time.
einfitting = EinsteinPatternFitting(Curves=crvs, OriginPoint=null, SetBlock=Button(), PlaceBlock=Button(), Scale=1)  # -> Previewshape, ExpensionData
show_hat = Show_All_HatName(IsOverwrite=Toggle(False))
einfitting_2 = EinsteinPatternFitting(
    Curves=crvs_2,
    OriginPoint=pt,
    SetBlock=Button(),
    PlaceBlock=Button(),
    Scale=Slider(0.4, range=0..1),
    Patterns=pattern_2.PatternSetting)  # -> Previewshape, ExpensionData
# Show all history block creation
panel = Panel(show_hat)
