# Grasshopper definition Test_2.gh (Grasshopper 1.0.7)
# plug-ins: Tile.Core.Grashopper

einfitting = EinsteinPatternFitting(Curves=<geometry referenced from the Rhino model>, OriginPoint=null, SetBlock=Button(), PlaceBlock=Button(), Scale=1)  # -> Previewshape, ExpensionData, CentralPtTest
panel = Panel("""H_1
P_2
T_4""")
show_hat = Show_All_HatName(IsOverwrite=False, RemoveName=panel)
panel_2 = Panel(show_hat)
