# Grasshopper definition Test.gh (Grasshopper 1.0.7)
# plug-ins: Tile.Core.Grashopper

crv = Curve(<curve referenced from the Rhino model>)  # disabled
number_slider = Slider(1, range=0..10)  # disabled
number_slider_2 = Slider(1.3, range=0..10)  # disabled
boundary = BoundarySurfaces(Edges=crv)  # disabled
number_slider_3 = Slider(0.1, range=0.1..10)  # disabled
number_slider_4 = Slider(1.404, range=1.1..2)  # disabled
popgeo = PopulateGeometry(Geometry=boundary, Count=100, Seed=1)  # disabled
crv_2 = Curve(<curve referenced from the Rhino model>)
button = Button()
panel = Panel("3")  # disabled
area = Area(Geometry=crv_2)  # -> Area, Centroid; disabled
c_script = CSharpScript(pts=popgeo, Alpha=number_slider_4)  # -> out, DelMesh, A, B, C; inputs pts: list of Point3d, Alpha: Double; disabled
# ---------- c_script: C# usings ----------
using System.Linq;
# ---------- c_script: C# ----------
    Mesh _DelMesh = GetDelaunayMesh(pts);
    
    Mesh Du_Mesh = _DelMesh.DuplicateMesh();
    List<Line> AllEdges;
    double Thre = AverageLength(Du_Mesh, out AllEdges) * Alpha;

    
    //DelMesh = _DelMesh;
    A = Thre;
    B = AllEdges;
    C = GenerateConcaveHull(Du_Mesh, Thre);
# ---------- c_script: C# additional code ----------
  public static Mesh GetDelaunayMesh(List<Point3d> pts)
  {
    //convert point3d to node2
    //grasshopper requres that nodes are saved within a Node2List for Delaunay
    var nodes = new Grasshopper.Kernel.Geometry.Node2List();
    for (int i = 0; i < pts.Count; i++)
    {
      //notice how we only read in the X and Y coordinates
      //  this is why points should be mapped onto the XY plane
      nodes.Append(new Grasshopper.Kernel.Geometry.Node2(pts[i].X, pts[i].Y));
    }

    //solve Delaunay
    var delMesh = new Mesh();
    var faces = new List<Grasshopper.Kernel.Geometry.Delaunay.Face>();

    faces = Grasshopper.Kernel.Geometry.Delaunay.Solver.Solve_Faces(nodes, 1);

    //output
    delMesh = Grasshopper.Kernel.Geometry.Delaunay.Solver.Solve_Mesh(nodes, 1, ref faces);
    return delMesh;
  }
  public static Mesh GenerateConcaveHull(Mesh delaunayMesh, double Thre)
  {
    List<Line> AllEdges;
    Mesh Copy_Mesh = delaunayMesh.DuplicateMesh();

    var EdgeIntList = GetNakedEdges(Copy_Mesh);
    List<int> RemoveInd = EdgeIntList.Where(x => Copy_Mesh.TopologyEdges.EdgeLine(x).Length > Thre).ToList();
    
    if(RemoveInd.Count == 0 || EdgeIntList.Count <= 3)
      return Copy_Mesh;
    else if(RemoveInd.Count > 1)
    {
      var faceInd = Copy_Mesh.TopologyEdges.GetConnectedFaces(RemoveInd[0])[0];
      Copy_Mesh.Faces.RemoveAt(faceInd);
      return GenerateConcaveHull(Copy_Mesh, Thre);
    }
    else
    {
      var faceInd = Copy_Mesh.TopologyEdges.GetConnectedFaces(RemoveInd[0])[0];
      Copy_Mesh.Faces.RemoveAt(faceInd);
      return Copy_Mesh;
    }
  }
  public static double AverageLength(Mesh mesh, out List<Line> AllEdges)
  {
    var CopyMesh = mesh.DuplicateMesh();
    AllEdges = new List<Line>();
    double Length = 0;
    for(int i = 0; i < CopyMesh.TopologyEdges.Count; i++)
    {
      Length += CopyMesh.TopologyEdges.EdgeLine(i).Length / CopyMesh.TopologyEdges.Count;
      AllEdges.Add(CopyMesh.TopologyEdges.EdgeLine(i));
    }
    return Length;
  }
  public static List<int> GetNakedEdges(Mesh mesh)
  {
    // Find the naked edges of the mesh
    var nakedEdges = new List<int>();
    for (int edgeIndex = 0; edgeIndex < mesh.TopologyEdges.Count; edgeIndex++)
    {
      if (mesh.TopologyEdges.GetConnectedFaces(edgeIndex).Length == 1)
      {
        nakedEdges.Add(edgeIndex);
      }
    }
    return nakedEdges;
  }
# ---------- end c_script ----------
panel_2 = Panel(c_script.C)  # disabled
len = Length(Curve=c_script.B)  # disabled
divlength = DivideLength(Curve=crv_2, Length=panel)  # -> Points, Tangents, Parameters; disabled
midpt = CurveMiddle(Curve=c_script.B)  # disabled
c_script_2 = CSharpScript(Border=crv_2, Reference="D:\研究所\MonoTiles\TilexHat\Tile.Core.Grashopper\bin\net48\Tile.Core.dll")  # -> out, A, B, C; inputs Border: Curve, Reset: Boolean
# ---------- c_script_2: C# usings ----------
using Tile.Core;
using System.Linq;
# ---------- c_script_2: C# ----------
    var TilesPair = EinIteration(Border);
    //List<Curve> Crv = TilesPair.Select(x => x.Value).ToList();
    var Con = ConcaveHull.GetConcaveHull(TilesPair, 1.1);
    A = Con.PointOnProfile;
    B = ConcaveHull.GetConcaveHull(TilesPair, 1.1).Profile;
    C = FinalCount;
# ---------- c_script_2: C# additional code ----------
  static int FinalCount = 0;
  Einstein _InternalEinstein = new Einstein();
  public List<Point3d> EinIteration(Curve Crv, int Count = 0)
  {
    if (Count == 0)
    {
      Count++;
      return EinIteration(Crv, Count);
    }
    else if(Count == 5)
      return null;
    else
    {
      this._InternalEinstein = new Einstein();
      for(int i = 0; i < Count; i++)
        this._InternalEinstein.NextIteration();
      var Tile = this._InternalEinstein.Draw(Einstein.Type.H);
      var Pts = Crv.DivideByLength(3, false);
      var CentrePt = Point3d.Origin;
      foreach(var Pt in Pts)
      {
        var TempPt = Crv.PointAt(Pt);
        CentrePt += TempPt / Pts.Length;
      }

      var Translate = Transform.Translation(new Vector3d(CentrePt));
      var Transforms = this._InternalEinstein.Hat_Transform;
      List<Point3d> PtSet = new List<Point3d>();
      for(int i = 0; i < Transforms.Count; i++)
      {
        var Pt = Point3d.Origin;
        Pt.Transform(Translate * Transforms[i]);
        PtSet.Add(Pt);
      }

      List<Point3d> OutPts = ConcaveHull.GetConcaveHull(PtSet, 1.1).PointOnProfile;

      bool c = false;

      for(int i = 0; i < OutPts.Count; i++)
      {
        c = c || Crv.Contains(OutPts[i]) == PointContainment.Inside;
      }

      if(c)
      {
        Count++;
        return EinIteration(Crv, Count);
      }
      else
      {
        FinalCount = Count;
        return PtSet;
      }
    }
    return null;
  }
  public struct ConcaveHullObject
  {
    private Mesh _ConcaveMesh;
    public ConcaveHullObject(Mesh ConcaveMesh)
    {
      this._ConcaveMesh = ConcaveMesh;
    }
    public Mesh GetMesh{get {return _ConcaveMesh;}}
    public List<int> ProfileIndex {get
      {
        return ConcaveHull.GetNakedEdges(this._ConcaveMesh);
      }
    }
    public Curve Profile{get {
        var Index = this.ProfileIndex;
        List<Line> AllEdges;
        ConcaveHull.AverageLength(this._ConcaveMesh, out AllEdges);
        var NakeEdges = Index.Select(x => new LineCurve(AllEdges[x])).ToList();
        var JoinCurve = Curve.JoinCurves(NakeEdges)[0];
        return JoinCurve;
      }}
    public List<Point3d> PointOnProfile {get
      {
        PolylineCurve PLN = this.Profile as PolylineCurve;
        return PLN.ToPolyline().ToList();
      }}
  }
  public static class ConcaveHull
  {
    public static ConcaveHullObject GetConcaveHull(List<Point3d> Pts, double Alpha)
    {
      Mesh delaunayMesh = GetDelaunayMesh(Pts);
      List<Line> AllEdges;
      double Thre = AverageLength(delaunayMesh, out AllEdges) * Alpha;
      Mesh HullMesh = GenerateConcaveHull(delaunayMesh, Thre);
      return new ConcaveHullObject(HullMesh);
    }
    public static Mesh GetDelaunayMesh(List<Point3d> pts)
    {
      //convert point3d to node2
      //grasshopper requres that nodes are saved within a Node2List for Delaunay
      var nodes = new Grasshopper.Kernel.Geometry.Node2List();
      for (int i = 0; i < pts.Count; i++)
      {
        //notice how we only read in the X and Y coordinates
        //  this is why points should be mapped onto the XY plane
        nodes.Append(new Grasshopper.Kernel.Geometry.Node2(pts[i].X, pts[i].Y));
      }

      //solve Delaunay
      var delMesh = new Mesh();
      var faces = new List<Grasshopper.Kernel.Geometry.Delaunay.Face>();

      faces = Grasshopper.Kernel.Geometry.Delaunay.Solver.Solve_Faces(nodes, 1);

      //output
      delMesh = Grasshopper.Kernel.Geometry.Delaunay.Solver.Solve_Mesh(nodes, 1, ref faces);
      return delMesh;
    }
    public static Mesh GenerateConcaveHull(Mesh delaunayMesh, double Thre)
    {
      List<Line> AllEdges;
      Mesh Copy_Mesh = delaunayMesh.DuplicateMesh();

      var EdgeIntList = GetNakedEdges(Copy_Mesh);
      List<int> RemoveInd = EdgeIntList.Where(x => Copy_Mesh.TopologyEdges.EdgeLine(x).Length > Thre).ToList();

      if(RemoveInd.Count == 0 || EdgeIntList.Count <= 3)
        return Copy_Mesh;
      else if(RemoveInd.Count > 1)
      {
        var faceInd = Copy_Mesh.TopologyEdges.GetConnectedFaces(RemoveInd[0])[0];
        Copy_Mesh.Faces.RemoveAt(faceInd);
        return GenerateConcaveHull(Copy_Mesh, Thre);
      }
      else
      {
        var faceInd = Copy_Mesh.TopologyEdges.GetConnectedFaces(RemoveInd[0])[0];
        Copy_Mesh.Faces.RemoveAt(faceInd);
        return Copy_Mesh;
      }
    }
    public static double AverageLength(Mesh mesh, out List<Line> AllEdges)
    {
      var CopyMesh = mesh.DuplicateMesh();
      AllEdges = new List<Line>();
      double Length = 0;
      for(int i = 0; i < CopyMesh.TopologyEdges.Count; i++)
      {
        Length += CopyMesh.TopologyEdges.EdgeLine(i).Length / CopyMesh.TopologyEdges.Count;
        AllEdges.Add(CopyMesh.TopologyEdges.EdgeLine(i));
      }
      return Length;
    }
    public static List<int> GetNakedEdges(Mesh mesh)
    {
      // Find the naked edges of the mesh
      var nakedEdges = new List<int>();
      for (int edgeIndex = 0; edgeIndex < mesh.TopologyEdges.Count; edgeIndex++)
      {
        if (mesh.TopologyEdges.GetConnectedFaces(edgeIndex).Length == 1)
        {
          nakedEdges.Add(edgeIndex);
        }
      }
      return nakedEdges;
    }
  }
# ---------- end c_script_2 ----------
crv_3 = Curve(<curve referenced from the Rhino model>)
list = ValueList({"MetaTiles": 0, "Hat": 1, "H": 2, "H1": 3, "T": 4, "P": 5, "F": 6, "All": 7}, selected="Hat")
item = ListItem(List=c_script_2.B, Index=0, Wrap=True)  # disabled
list_2 = ValueList({"H": 0, "T": 1, "P": 2, "F": 3}, selected="T")
button_2 = Button()  # disabled
button_3 = Button()  # disabled
round = Round(Number=len)  # -> Nearest, Floor, Ceiling; disabled
avr = Average(Input=divlength.Points)  # disabled
c_script_3 = CSharpScript(Crv=crv_3)  # -> out, A; inputs Crv: Curve
# ---------- c_script_3: C# ----------
    if(Crv is PolylineCurve)
    {
      var PL = (Crv as PolylineCurve).ToPolyline().CenterPoint();
      A = PL; 

    }
# ---------- end c_script_3 ----------
tag = TextTag(Location=midpt, Text=round.Nearest)  # disabled
c_script_4 = CSharpScript(Iter=button_3, Reset=button_2, Reference="D:\研究所\MonoTiles\TilexHat\Tile.Core.Grashopper\bin\net48\Tile.Core.dll")  # -> out, A; inputs Iter: Boolean, Reset: Boolean; disabled
# ---------- c_script_4: C# usings ----------
using Tile.Core;
# ---------- c_script_4: C# ----------
    if(Reset)
      Count = 0;
    if(Iter)
      Count++;

    var Ein = new Einstein();
    Ein.reset();

    for(int i = 0; i < Count; i++)
      Ein.NextIteration();

    var Tile = Ein.Draw(Einstein.Type.H);

    A = Tile;
# ---------- c_script_4: C# additional code ----------
  int Count = 0;
# ---------- end c_script_4 ----------
mesh = Mesh(c_script.C)  # disabled
panel_3 = Panel(c_script.A)  # disabled
panel_4 = Panel(c_script_2.C)  # disabled
panel_5 = Panel(c_script_2.A)  # disabled
panel_6 = Panel(c_script_2.B)  # disabled
eincore = EinsteinCore(Reset=Button(), Execute=Button(), InitialType=list_2, Display=list)  # -> Geom, Level, Data, EinsteinData
crv_4 = Curve(eincore.Geom)
panel_7 = Panel(c_script_4.A)  # disabled
panel_8 = Panel(eincore.Level)
einpatch = EinsteinPatternPatch(Einstein=eincore.EinsteinData, OriginPoint=Point(0, 0, 0), SetBlock=Button(), PlaceBlock=Button(), Scale=1)
number_slider_5 = Slider(0, range=0..4)  # disabled
button_4 = Button()  # disabled
button_5 = Button()  # disabled
c_script_5 = CSharpScript(Border=crv_2, Reference="D:\研究所\MonoTiles\TilexHat\Tile.Core.Grashopper\bin\net48\Tile.Core.dll")  # -> out, A, B, C; inputs Border: Curve, Reset: Boolean; disabled
# ---------- c_script_5: C# usings ----------
using Tile.Core;
using System.Linq;
using Tile.Core.Hull;
using System.Threading.Tasks;
using System.Collections.Concurrent;
# ---------- c_script_5: C# ----------
    this.ConvexHull = Border;
    
    var centrePt = (Border as PolylineCurve).ToPolyline().CenterPoint();
    this.Translation = Transform.Translation(new Vector3d(centrePt));
    
    FormingIterator();
    
    A = FinalLevel;
    
    //List<Curve> Crv = TilesPair.Select(x => x.Value).ToList();
# ---------- c_script_5: C# additional code ----------
  static int FinalLevel = 0;
  double Hatsize = 1;
  Transform Translation = Transform.Identity;
  Einstein _InternalEinstein = new Einstein();
  public class ExpensionData
  {
    public Einstein.Type Type { get; private set;}
    public List<Transform> HatTransform { get; private set; }
    public bool Result { get; private set; }
    public ExpensionData(Einstein.Type Type)
    {
      this.Type = Type;
      HatTransform = new List<Transform>();
      Result = false;
    }
    public void SetResult(bool Result)
    {
      this.Result = Result;
    }
    public void SetTransform(List<Transform> HatTransform)
    {
      this.HatTransform = HatTransform;
    }
  }
  Curve ConvexHull {get; set;}
  double Alpha = 1.1;
  public bool FormingIterator(int Count = 0)
  {
    if (Count == 0)
    {
      this._InternalEinstein = new Einstein();
      Count++;
      return FormingIterator(Count);
    }
    else
    {
      this._InternalEinstein.NextIteration();
      var MetaType = new Dictionary<Einstein.Type, ExpensionData>()
        {
          {Einstein.Type.H, new ExpensionData(Einstein.Type.H)},
          {Einstein.Type.P, new ExpensionData(Einstein.Type.P)}
          };
      ConcurrentBag<ExpensionData> Parallel_Output = new ConcurrentBag<ExpensionData>();
      Parallel.ForEach(MetaType, t =>
        {
        var type = t.Key;
        var expensionData = t.Value;
        this._InternalEinstein.Draw(type);

        List<Transform> TS = this._InternalEinstein.Hat_Transform;
        List<Point3d> PtsSet = this.PermuteHatPts(TS);
        List<Point3d> ConcavePt = Concave_Hull.ConcaveHull2D(PtsSet, Alpha).PointOnProfile;
        bool Result = this.IsAllInsideConcaveHull(ConcavePt);

        lock (expensionData)
        {
          expensionData.SetResult(Result);
          expensionData.SetTransform(TS);
          Parallel_Output.Add(expensionData);
        }
        });

      //true     some points are inside the hull
      //false    All points are outside the hull
      var BoolResult = Parallel_Output.Select(x => x.Result).ToList()[0] 
        && Parallel_Output.Select(x => x.Result).ToList()[1];

      if (!BoolResult)
      {
        FinalLevel = Count;
        var Target = Parallel_Output.Where(x => !x.Result).ToList();
        return true;
      }
      else
      {
        Count++;
        return this.FormingIterator(Count);
      }
    }
  }
  private bool IsAllInsideConcaveHull(IEnumerable<Point3d> ConcavePts)
  {
    List<Point3d> Pts = ConcavePts.ToList();
    bool c = false;
    foreach(var Pt in Pts)
    {
      c = c || ConvexHull.Contains(Pt, Plane.WorldXY, 0.1) == PointContainment.Inside;
    }
    return c;
  }
  private List<Point3d> PermuteHatPts(IEnumerable<Transform> HatTransform)
  {
    List<Transform> HatTS = HatTransform.ToList();
    ConcurrentBag<Point3d> PtsSet = new ConcurrentBag<Point3d>();
    var Scale = Transform.Scale(Point3d.Origin, Hatsize);
    Parallel.For(0, HatTS.Count, i => 
      {
      var Final = Translation * Scale * HatTS[i];
      var Pt = Point3d.Origin;
      Pt.Transform(Final);
      PtsSet.Add(Pt);
      });
    return PtsSet.ToList();
  }
# ---------- end c_script_5 ----------
c_script_6 = CSharpScript(
    Add=button_5,
    Reset=button_4,
    Ind=number_slider_5,
    Reference="D:\研究所\MonoTiles\TilexHat\Tile.Core.Grashopper\bin\net48\Tile.Core.dll")  # -> out, B, A; inputs Add: Boolean, Reset: Boolean, Ind: Int32; disabled
# ---------- c_script_6: C# usings ----------
using Tile.Core;
using System.Threading.Tasks;
using System.Collections.Concurrent;
using System.Linq;
# ---------- c_script_6: C# ----------
  if(Add)
  Count++;
  if(Reset)
  Count = 0;

  var Ein = new Einstein();
  for(int i = 0; i < Count; i++)
  Ein.NextIteration();
  
    ConcurrentBag<List<Curve>> ConPoint = new ConcurrentBag<List<Curve>>();
    
  Parallel.For(0, 4, i => 
  {
      if(i == 0)
      {
        var TilePairs = Ein.Draw(Tile.Core.Einstein.Type.H);
        var Crvs = TilePairs.Select(x => x.Value).ToList();
        ConPoint.Add(Crvs);
      }
      else if(i == 1)
      {
        var TilePairs = Ein.Draw(Tile.Core.Einstein.Type.T);
        var Crvs = TilePairs.Select(x => x.Value).ToList();
        ConPoint.Add(Crvs);
      }
      else if(i == 2)
      {
        var TilePairs = Ein.Draw(Tile.Core.Einstein.Type.P);
        var Crvs = TilePairs.Select(x => x.Value).ToList();
        ConPoint.Add(Crvs);
      }
      else if(i == 3)
      {
        var TilePairs = Ein.Draw(Tile.Core.Einstein.Type.F);
        var Crvs = TilePairs.Select(x => x.Value).ToList();
        ConPoint.Add(Crvs);
      }
  });
    var ConList = ConPoint.ToList();
  Ein.Draw();
  B = Ein.Level;
  A = ConList[Ind];
# ---------- c_script_6: C# additional code ----------
  int Count = 0;
# ---------- end c_script_6 ----------
panel_9 = Panel(c_script_5.A)  # disabled
panel_10 = Panel(c_script_6.B)  # disabled
panel_11 = Panel(c_script_6.A)  # disabled
crv_5 = Curve(<curve referenced from the Rhino model>)
pt = Point(Point(62.43298106, 41.7327002, 0))
crv_6 = Curve(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)
crv_7 = Curve(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)
c_script_7 = CSharpScript(Crvs=crv_5, Pt=pt, Reference="D:\研究所\MonoTiles\TilexHat\Tile.Core.Grashopper\bin\net48\Tile.Core.dll")  # -> out, A; inputs Crvs: list of Curve, Pt: Point3d
# ---------- c_script_7: C# ----------
    var Ein = new Einstein_Forming(Crvs, StartPt:Pt, Hatsize:5);
    A = Ein.EinIteration();
# ---------- end c_script_7 ----------
c_script_8 = CSharpScript(x=c_script_7.A, Reference="D:\研究所\MonoTiles\TilexHat\Tile.Core.Grashopper\bin\net48\Tile.Core.dll")  # -> out, A
# ---------- c_script_8: C# ----------
    var Exp = x as Tile.Core.ExpensionData;
    
    A = Exp.HatPt;
# ---------- end c_script_8 ----------
panel_12 = Panel(c_script_7.A)
lng = ListLength(List=[Point(73.05035154, 41.57390523, 0), Point(74.55035154, 42.43993063, 0), Point(73.05035154, 39.84185442, 0), Point(71.55035154, 44.17198144, 0), Point(73.05035154, 43.30595604, 0), Point(73.05035154, 45.03800685, 0)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])
lng_2 = ListLength(List=c_script_8.A)
panel_13 = Panel(lng)
panel_14 = Panel(lng_2)
